# Grasshopper definition 270420 RADIATION_SUNLIGHT_VIEW - ANALYSIS.gh (Grasshopper 0.9.76)
# plug-ins: Python Interpreter, Pufferfish, Bifocals, LunchBox, TT Toolbox

# ---- group: PANEL 1 (HUMMINGBIRD)
# PANEL GEOMETRY
xz_plane = XZPlane(Origin=Point(0, 0, 0))
triangular = Triangular(Plane=xz_plane, Size=Slider(1, range=1..20), ExtentX=Slider(1, range=1..20), ExtentY=Slider(1, range=1..20))  # -> Cells, Points
deconstruct_mesh = DeconstructMesh(Mesh=triangular.Cells)  # -> Vertices, Faces, Colours, Normals
list_item = ListItem(List=deconstruct_mesh.Vertices, Index=0, Wrap=True)  # -> Item, Item1, Item2, Item3, Item4, Item5
point = Point(list_item.Item2)
point_2 = Point(list_item.Item)
point_3 = Point(list_item.Item4)
unit_x = UnitX(Factor=Slider(-0.24, range=-10..10))
unit_x_2 = UnitX(Factor=Slider(0.24, range=-10..10))
unit_z = UnitZ(Factor=Slider(0.4, range=0..10))
unit_z_2 = UnitZ(Factor=Slider(-1, range=-1..1))
move = Move(Geometry=point_2, Motion=unit_x)  # -> Geometry, Transform
move_2 = Move(Geometry=point, Motion=unit_x_2)  # -> Geometry, Transform
move_3 = Move(Geometry=point_3, Motion=unit_z)  # -> Geometry, Transform
arc_sed = ArcSED(Start=move.Geometry, End=move_2.Geometry, Direction=unit_z_2)  # -> Arc, Plane, Radius
line = Line(StartPoint=move.Geometry, EndPoint=move_3.Geometry)
line_2 = Line(StartPoint=move_2.Geometry, EndPoint=move_3.Geometry)
boundary_surfaces = BoundarySurfaces(Edges=[line, line_2, arc_sed.Arc])
panel_a = Surface(boundary_surfaces)

# ---- group: GEOMETRY INPUT
feather_panel_a_hummingbird = Surface(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)
feather_panel_b_diamond = Surface(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)

# ----
# OFFICE MASS FACES
office_floors_30x50 = Brep(<brep referenced from the Rhino model>)

# ---- group: PANEL ROTATION & SCALE
xz_plane_2 = XZPlane(Origin=Point(0, 0, 0))
rotate = Rotate(Geometry=feather_panel_a_hummingbird, Angle=1.570796327, Plane=xz_plane_2)  # -> Geometry, Transform
xy_plane = XYPlane(Origin=Point(0, 0, 0))
number_slider = Slider(0.5, range=0..10)
rotate_2 = Rotate(Geometry=rotate.Geometry, Angle=1.570796327, Plane=xy_plane)  # -> Geometry, Transform
scale = Scale(Geometry=rotate.Geometry, Center=Point(0, 0, 0), Factor=number_slider)  # -> Geometry, Transform
scale_2 = Scale(Geometry=rotate_2.Geometry, Center=Point(0, 0, 0), Factor=number_slider)  # -> Geometry, Transform

# ----
# PANEL ROTATION & SCALING
colour_swatch = ColourSwatch(SwatchColor=RGB(255, 255, 255))
deconstruct_brep = DeconstructBrep(Brep=office_floors_30x50)  # -> Faces, Edges, Vertices
custom_preview = CustomPreview(Geometry=office_floors_30x50, Shader=colour_swatch)
list_item_2 = ListItem(List=deconstruct_brep.Faces, Index=0, Wrap=True)  # -> Item, Item1, Item2, Item3

# ---- group: SOUTH
south_face = Surface(list_item_2.Item)

# ---- group: EAST
east_face = Surface(list_item_2.Item1)

# ---- group: NORTH
north_face = Surface(list_item_2.Item2)

# ---- group: WEST
west_face = Surface(list_item_2.Item3)

# ---- group: FACE SCALING
offset = Offset(Surface=south_face, Distance="1", Retrim=True)
area = Area(Geometry=offset)  # -> Area, Centroid
scale_3 = Scale(Geometry=offset, Center=area.Centroid, Factor=Slider(0.9, range=0..5))  # -> Geometry, Transform

offset_2 = Offset(Surface=west_face, Distance="1", Retrim=True)
area_2 = Area(Geometry=offset_2)  # -> Area, Centroid
scale_4 = Scale(Geometry=offset_2, Center=area_2.Centroid, Factor=Slider(0.9, range=0..5))  # -> Geometry, Transform

offset_3 = Offset(Surface=north_face, Distance="1", Retrim=True)
area_3 = Area(Geometry=offset_3)  # -> Area, Centroid
scale_5 = Scale(Geometry=offset_3, Center=area_3.Centroid, Factor=Slider(0.9, range=0..5))  # -> Geometry, Transform

offset_4 = Offset(Surface=east_face, Distance="1", Retrim=True)
area_4 = Area(Geometry=offset_4)  # -> Area, Centroid
scale_6 = Scale(Geometry=offset_4, Center=area_4.Centroid, Factor=Slider(0.9, range=0..5))  # -> Geometry, Transform

# ---- group: PANEL AXIS
panel_x_axis = Surface(scale.Geometry)
panel_y_axis = Surface(scale_2.Geometry)

# ---- group: GRID SPACING - X AXIS
east_face_scaled = Surface(scale_6.Geometry)
braced_grid_2_d_structure = BracedGrid2DStructure(Surface=east_face_scaled, UDivisions=Slider(8, range=0..20), VDivisions=Slider(30, range=0..200))  # -> PrimaryLines, BraceLines, StructureNodes

west_face_scaled = Surface(scale_4.Geometry)
braced_grid_2_d_structure_2 = BracedGrid2DStructure(Surface=west_face_scaled, UDivisions=Slider(8, range=0..20), VDivisions=Slider(30, range=0..200))  # -> PrimaryLines, BraceLines, StructureNodes

# ---- group: GRID SPACING - Y AXIS
south_face_scaled = Surface(scale_3.Geometry)
braced_grid_2_d_structure_3 = BracedGrid2DStructure(Surface=south_face_scaled, UDivisions=Slider(5, range=0..200), VDivisions=Slider(30, range=0..200))  # -> PrimaryLines, BraceLines, StructureNodes

north_face_scaled = Surface(scale_5.Geometry)
braced_grid_2_d_structure_4 = BracedGrid2DStructure(Surface=north_face_scaled, UDivisions=Slider(5, range=0..200), VDivisions=Slider(30, range=0..200))  # -> PrimaryLines, BraceLines, StructureNodes

# ---- group: PANEL 2 (DIAMOND)
xy_plane_2 = XYPlane(Origin=Point(0, 0, 0))
triangular_2 = Triangular(Plane=xy_plane_2, Size=Slider(9, range=1..20), ExtentX=Slider(1, range=1..20), ExtentY=Slider(1, range=1..20))  # -> Cells, Points
rotate_3 = Rotate(Geometry=triangular_2.Cells, Angle=degrees(Slider(240, range=1..360)), Plane=PlaneXY(0, 0, 0))  # -> Geometry, Transform
deconstruct_mesh_2 = DeconstructMesh(Mesh=rotate_3.Geometry)  # -> Vertices, Faces, Colours, Normals
list_item_3 = ListItem(List=deconstruct_mesh_2.Vertices, Index=0, Wrap=True)  # -> Item, Item1, Item2, Item3, Item4, Item5
point_4 = Point(list_item_3.Item)
point_5 = Point(list_item_3.Item2)
point_6 = Point(list_item_3.Item4)
unit_y = UnitY(Factor=Slider(-3, range=-10..10))
move_4 = Move(Geometry=point_4, Motion=unit_y)  # -> Geometry, Transform
line_3 = Line(StartPoint=move_4.Geometry, EndPoint=point_5)
line_4 = Line(StartPoint=move_4.Geometry, EndPoint=point_6)
line_5 = Line(StartPoint=point_5, EndPoint=point_6)
point_on_curve = PointOnCurve(line_5, parameter=0.5)
unit_y_2 = UnitY(Factor=Slider(-10, range=-15..15))
move_5 = Move(Geometry=point_on_curve, Motion=unit_y_2)  # -> Geometry, Transform
line_6 = Line(StartPoint=point_6, EndPoint=move_5.Geometry)
line_7 = Line(StartPoint=point_5, EndPoint=move_5.Geometry)
boundary_surfaces_2 = BoundarySurfaces(Edges=[line_3, line_4, line_6, line_7])
rotate_4 = Rotate(Geometry=boundary_surfaces_2, Angle=degrees(Slider(270, range=0..360)), Plane=PlaneXY(0, 0, 0))  # -> Geometry, Transform
unit_x_3 = UnitX(Factor=Slider(3, range=0..10))
move_6 = Move(Geometry=rotate_4.Geometry, Motion=unit_x_3)  # -> Geometry, Transform
panel_b = Surface(move_6.Geometry)

# ---- group: HORIZONTAL ROTATION
# EAST
number_slider_2 = Slider(0, range=-50..100)
_15_right = Slider(15, range=-50..100)
_45_right = Slider(45, range=-50..100)
_15_left = Slider(-15, range=-50..100)
_45_left = Slider(-45, range=-50..100)
xy_plane_3 = XYPlane(Origin=Point(0, 0, 0))
rotate_5 = Rotate(Geometry=panel_x_axis, Angle=degrees(_15_right), Plane=xy_plane_3)  # -> Geometry, Transform

# SOUTH
number_slider_3 = Slider(0, range=-50..100)
_15_right_2 = Slider(15, range=-50..100)
_45_right_2 = Slider(45, range=-50..100)
_15_left_2 = Slider(-15, range=-50..100)
_45_left_2 = Slider(-45, range=-50..100)
xy_plane_4 = XYPlane(Origin=Point(0, 0, 0))
rotate_6 = Rotate(Geometry=panel_y_axis, Angle=degrees(_15_left_2), Plane=xy_plane_4)  # -> Geometry, Transform

# NORTH
number_slider_4 = Slider(0, range=-50..100)
_15_right_3 = Slider(15, range=-50..100)
_45_right_3 = Slider(45, range=-50..100)
_15_left_3 = Slider(-15, range=-50..100)
_45_left_3 = Slider(-45, range=-50..100)
xy_plane_5 = XYPlane(Origin=Point(0, 0, 0))
rotate_7 = Rotate(Geometry=panel_y_axis, Angle=degrees(_45_right_3), Plane=xy_plane_5)  # -> Geometry, Transform

# ---- group: VERTICAL ROTATION
bounding_box = BoundingBox(Content=flatten(east_face_scaled), Plane=PlaneXY(0, 0, 0), UnionBox=True)  # -> Box, Box_2
vertical_behaviour_east = VerticalBehaviourEast()  # -> march, june, september, december
evaluate_surface = EvaluateSurface(Surface=reparameterize(bounding_box.Box), Point=vertical_behaviour_east.september)  # -> Point, Normal, Frame
_5_min = Slider(0.09, range=-2..2)
number_slider_5 = Slider(0.27, range=-2..2)
number_slider_6 = Slider(0.79, range=-2..2)
number_slider_7 = Slider(1.05, range=-2..2)
number_slider_8 = Slider(1.58, range=-2..2)
closest_point = ClosestPoint(Point=braced_grid_2_d_structure.StructureNodes, Cloud=evaluate_surface.Point)  # -> ClosestPoint, CPIndex, Distance
bounds = Bounds(Numbers=flatten(closest_point.Distance))
construct_domain = ConstructDomain(DomainStart=number_slider_6, DomainEnd=number_slider_7)
remap_numbers = RemapNumbers(Value=closest_point.Distance, Source=bounds, Target=construct_domain)  # -> Mapped, Clipped
xz_plane_3 = XZPlane(Origin=Point(0, 0, 0))
rotate_8 = Rotate(Geometry=rotate_5.Geometry, Angle=remap_numbers.Mapped, Plane=xz_plane_3)  # -> Geometry, Transform

bounding_box_2 = BoundingBox(Content=flatten(south_face_scaled), Plane=PlaneXY(0, 0, 0), UnionBox=True)  # -> Box, Box_2
vertical_behaviour_south = VerticalBehaviourSouth()  # -> march, june, september, december
evaluate_surface_2 = EvaluateSurface(Surface=reparameterize(bounding_box_2.Box), Point=vertical_behaviour_south.september)  # -> Point, Normal, Frame
_5_min_2 = Slider(-0.09, range=-1..1)
number_slider_9 = Slider(-0.27, range=-1..1)
number_slider_10 = Slider(-0.79, range=-2..2)
number_slider_11 = Slider(-1.05, range=-2..2)
number_slider_12 = Slider(-1.5, range=-2..2)
closest_point_2 = ClosestPoint(Point=braced_grid_2_d_structure_3.StructureNodes, Cloud=evaluate_surface_2.Point)  # -> ClosestPoint, CPIndex, Distance
bounds_2 = Bounds(Numbers=flatten(closest_point_2.Distance))
construct_domain_2 = ConstructDomain(DomainStart=number_slider_11, DomainEnd=number_slider_11)
remap_numbers_2 = RemapNumbers(Value=closest_point_2.Distance, Source=bounds_2, Target=construct_domain_2)  # -> Mapped, Clipped
yz_plane = YZPlane(Origin=Point(0, 0, 0))
rotate_9 = Rotate(Geometry=rotate_6.Geometry, Angle=remap_numbers_2.Mapped, Plane=yz_plane)  # -> Geometry, Transform

bounding_box_3 = BoundingBox(Content=flatten(north_face_scaled), Plane=PlaneXY(0, 0, 0), UnionBox=True)  # -> Box, Box_2
vertical_behaviour_north = VerticalBehaviourNorth()  # -> march, june, september, december
evaluate_surface_3 = EvaluateSurface(Surface=reparameterize(bounding_box_3.Box), Point=vertical_behaviour_north.september)  # -> Point, Normal, Frame
number_slider_13 = Slider(0.79, range=-2..2)
_5_min_3 = Slider(0.09, range=-2..2)
number_slider_14 = Slider(0.27, range=-2..2)
number_slider_15 = Slider(1.05, range=-2..2)
number_slider_16 = Slider(1.58, range=-2..2)
closest_point_3 = ClosestPoint(Point=braced_grid_2_d_structure_4.StructureNodes, Cloud=evaluate_surface_3.Point)  # -> ClosestPoint, CPIndex, Distance
bounds_3 = Bounds(Numbers=flatten(closest_point_3.Distance))
construct_domain_3 = ConstructDomain(DomainStart=number_slider_13, DomainEnd=number_slider_13)
remap_numbers_3 = RemapNumbers(Value=closest_point_3.Distance, Source=bounds_3, Target=construct_domain_3)  # -> Mapped, Clipped
yz_plane_2 = YZPlane(Origin=Point(0, 0, 0))
rotate_10 = Rotate(Geometry=rotate_7.Geometry, Angle=remap_numbers_3.Mapped, Plane=yz_plane_2)  # -> Geometry, Transform

# ---- group: HORIZONTAL ROTATION
# WEST
number_slider_17 = Slider(0, range=-50..100)
_15_left_4 = Slider(-15, range=-50..100)
_45_left_4 = Slider(-45, range=-50..100)
_15_right_4 = Slider(15, range=-50..100)
_45_right_4 = Slider(45, range=-50..100)
xy_plane_6 = XYPlane(Origin=Point(0, 0, 0))
rotate_11 = Rotate(Geometry=panel_x_axis, Angle=degrees(_15_left_4), Plane=xy_plane_6)  # -> Geometry, Transform

# ---- group: VERTICAL ROTATION
bounding_box_4 = BoundingBox(Content=flatten(west_face_scaled), Plane=PlaneXY(0, 0, 0), UnionBox=True)  # -> Box, Box_2
vertical_behaviour_west = VerticalBehaviourWest()  # -> march, june, september, december
evaluate_surface_4 = EvaluateSurface(Surface=reparameterize(bounding_box_4.Box), Point=vertical_behaviour_west.september)  # -> Point, Normal, Frame
_5_min_4 = Slider(-0.09, range=-2..2)
number_slider_18 = Slider(-0.27, range=-2..2)
number_slider_19 = Slider(-0.79, range=-2..2)
number_slider_20 = Slider(-1.05, range=-2..2)
number_slider_21 = Slider(-1.58, range=-2..2)
closest_point_4 = ClosestPoint(Point=braced_grid_2_d_structure_2.StructureNodes, Cloud=evaluate_surface_4.Point)  # -> ClosestPoint, CPIndex, Distance
bounds_4 = Bounds(Numbers=flatten(closest_point_4.Distance))
construct_domain_4 = ConstructDomain(DomainStart=number_slider_18, DomainEnd=number_slider_18)
remap_numbers_4 = RemapNumbers(Value=closest_point_4.Distance, Source=bounds_4, Target=construct_domain_4)  # -> Mapped, Clipped
xz_plane_4 = XZPlane(Origin=Point(0, 0, 0))
rotate_12 = Rotate(Geometry=rotate_11.Geometry, Angle=remap_numbers_4.Mapped, Plane=xz_plane_4)  # -> Geometry, Transform

# ----
move_7 = Move(Geometry=rotate_10.Geometry, Motion=braced_grid_2_d_structure_4.StructureNodes)  # -> Geometry, Transform
move_8 = Move(Geometry=rotate_12.Geometry, Motion=braced_grid_2_d_structure_2.StructureNodes)  # -> Geometry, Transform
move_9 = Move(Geometry=rotate_8.Geometry, Motion=braced_grid_2_d_structure.StructureNodes)  # -> Geometry, Transform
move_10 = Move(Geometry=rotate_9.Geometry, Motion=braced_grid_2_d_structure_3.StructureNodes)  # -> Geometry, Transform
custom_preview_2 = CustomPreview(Geometry=move_7.Geometry, Shader=ColourSwatch(SwatchColor=RGB(212, 219, 0)))
custom_preview_3 = CustomPreview(Geometry=move_8.Geometry, Shader=ColourSwatch(SwatchColor=RGB(35, 155, 176)))

# ---- group: DEGREES OF ANGLE
east_face_2 = Surface(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)
angle = Angle(VectorA=east_face_2, VectorB=move_9.Geometry)  # -> Angle, Reflex
degrees = Degrees(Radians=angle.Angle)
sort_list = SortList(Keys=degrees, ValuesValuesA=move_9.Geometry)  # -> reverse(Keys), ValuesValuesA
list_item_4 = ListItem(List=sort_list.Keys, Index=0, Wrap=True)
list_item_5 = ListItem(List=reverse(sort_list.Keys), Index=0, Wrap=True)
number = Number(list_item_4)
number_2 = Number(list_item_5)
round_to_decimal_place = RoundToDecimalPlace(NumberX=number, DecimalPlace="0", RoundType=0)  # -> Rounded, Difference
round_to_decimal_place_2 = RoundToDecimalPlace(NumberX=number_2, DecimalPlace="0", RoundType=0)  # -> Rounded, Difference
max_degree = Panel(round_to_decimal_place.Rounded)
min_degree = Panel(round_to_decimal_place_2.Rounded)

south_face_2 = Surface(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)
angle_2 = Angle(VectorA=south_face_2, VectorB=move_10.Geometry)  # -> Angle, Reflex
degrees_2 = Degrees(Radians=angle_2.Angle)
sort_list_2 = SortList(Keys=degrees_2, ValuesValuesA=move_10.Geometry)  # -> Keys, ValuesValuesA
subtraction = Subtraction(A="180", B=sort_list_2.Keys)
list_item_6 = ListItem(List=subtraction, Index=0, Wrap=True)
list_item_7 = ListItem(List=reverse(subtraction), Index=0, Wrap=True)
number_3 = Number(list_item_6)
number_4 = Number(list_item_7)
round_to_decimal_place_3 = RoundToDecimalPlace(NumberX=number_3, DecimalPlace="0", RoundType=0)  # -> Rounded, Difference
round_to_decimal_place_4 = RoundToDecimalPlace(NumberX=number_4, DecimalPlace="0", RoundType=0)  # -> Rounded, Difference
max_degree_2 = Panel(round_to_decimal_place_3.Rounded)
min_degree_2 = Panel(round_to_decimal_place_4.Rounded)

north_face_2 = Surface(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)
angle_3 = Angle(VectorA=north_face_2, VectorB=move_7.Geometry)  # -> Angle, Reflex
degrees_3 = Degrees(Radians=angle_3.Angle)
sort_list_3 = SortList(Keys=degrees_3, ValuesValuesA=move_7.Geometry)  # -> reverse(Keys), ValuesValuesA
list_item_8 = ListItem(List=sort_list_3.Keys, Index=0, Wrap=True)
list_item_9 = ListItem(List=reverse(sort_list_3.Keys), Index=0, Wrap=True)
number_5 = Number(list_item_8)
number_6 = Number(list_item_9)
round_to_decimal_place_5 = RoundToDecimalPlace(NumberX=number_5, DecimalPlace="0", RoundType=0)  # -> Rounded, Difference
round_to_decimal_place_6 = RoundToDecimalPlace(NumberX=number_6, DecimalPlace="0", RoundType=0)  # -> Rounded, Difference
max_degree_3 = Panel(round_to_decimal_place_5.Rounded)
min_degree_3 = Panel(round_to_decimal_place_6.Rounded)

west_face_2 = Surface(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)
angle_4 = Angle(VectorA=west_face_2, VectorB=move_8.Geometry)  # -> Angle, Reflex
degrees_4 = Degrees(Radians=angle_4.Angle)
sort_list_4 = SortList(Keys=degrees_4, ValuesValuesA=move_8.Geometry)  # -> Keys, ValuesValuesA
subtraction_2 = Subtraction(A="180", B=sort_list_4.Keys)
list_item_10 = ListItem(List=subtraction_2, Index=0, Wrap=True)
list_item_11 = ListItem(List=reverse(subtraction_2), Index=0, Wrap=True)
number_7 = Number(list_item_10)
number_8 = Number(list_item_11)
round_to_decimal_place_7 = RoundToDecimalPlace(NumberX=number_7, DecimalPlace="0", RoundType=0)  # -> Rounded, Difference
round_to_decimal_place_8 = RoundToDecimalPlace(NumberX=number_8, DecimalPlace="0", RoundType=0)  # -> Rounded, Difference
min_degree_4 = Panel(round_to_decimal_place_8.Rounded)
max_degree_4 = Panel(round_to_decimal_place_7.Rounded)

# ----
custom_preview_4 = CustomPreview(Geometry=move_10.Geometry, Shader=ColourSwatch(SwatchColor=RGB(36, 153, 18)))
custom_preview_5 = CustomPreview(Geometry=move_9.Geometry, Shader=ColourSwatch(SwatchColor=RGB(213, 67, 230)))
ladybug = Ladybug_Ladybug()  # -> out; plug-in component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
file_path = FilePath("C:\Users\URSULA\Desktop\THESIS\EPW FILES\JAKARTA_MONAS\IDN_JW_Jakarta.Obs.967450_TMYx.epw")
panel = Panel(ladybug)
panel_2 = Panel(file_path)
merge = Merge(Data1=move_10.Geometry, Data2=move_9.Geometry, Data3=move_7.Geometry, Data4=move_8.Geometry)

analysisperiod = Ladybug_AnalysisPeriod(
    fromMonth=Slider(6, range=1..12),
    fromDay=Slider(21, range=1..31),
    fromHour=Slider(9, range=1..24),
    toMonth=Slider(6, range=1..12),
    toDay=Slider(23, range=1..31),
    toHour=Slider(17, range=1..24))  # -> out, analysisPeriod; plug-in component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

importepw = Ladybug_ImportEpw(epwFile=file_path)  # -> Output, latitude, location, dryBulbTemperature, dewPointTemperature, relativeHumidity, windSpeed, windDirection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; plug-in component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
gencumulativeskymtx = Ladybug_GenCumulativeSkyMtx(epwFile=file_path, skyDensity=0, useOldRes=True, runIt=Toggle(True))  # -> out, cumulativeSkyMtx; plug-in component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

# ---- group: WIND ROSE & PROFILE
boolean_toggle = BooleanToggle(False)
boolean_toggle_2 = BooleanToggle(False)

# WIND ROSE & PROFILE
number_slider_22 = Slider(11, range=1..23)
gradientlibrary = Ladybug_GradientLibrary(gradIndex=number_slider_22)  # -> customColors; plug-in component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
legendpar = Ladybug_LegendParameters(
    customColors=flatten(gradientlibrary),
    legendScale=Slider(1, range=0..10),
    font="Arial Narrow",
    fontSize=Slider(12, range=0..100),
    decimalPlaces=Slider(3, range=0..10))  # -> legendPar; plug-in component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
point_7 = Point(Point(0, 89.60729297, 0))
windrose = Ladybug_WindRose(
    north=0,
    hourlyWindDirection=importepw.windDirection,
    hourlyWindSpeed=importepw.windSpeed,
    analysisPeriod=analysisperiod.analysisPeriod,
    centerPoint=point_7,
    showFrequency=reverse(Toggle(True)),
    showAverageVelocity=Toggle(True),
    scale=Slider(2, range=0..10),
    legendPar=legendpar,
    bakeIt=boolean_toggle,
    runIt=boolean_toggle_2)  # -> out, calmRoseMesh, windRoseMesh, windRoseCrvs, windRoseCenPts, legend, legendBasePts, title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; plug-in component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
gradientlibrary_2 = Ladybug_GradientLibrary(gradIndex=Slider(11, range=1..23))  # -> customColors; plug-in component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
number_slider_23 = Slider(0, range=0..100)
legendpar_2 = Ladybug_LegendParameters(
    customColors=flatten(gradientlibrary_2),
    legendScale=Slider(0.7, range=0..5),
    font="Arial Narrow",
    fontSize=Slider(5, range=0..100),
    decimalPlaces=Slider(2, range=0..10))  # -> legendPar; plug-in component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
point_8 = Point(Point(-15, 89.60729297, 0))
windboundaryprofile = Ladybug_WindBoundaryProfile(
    windSpeed_tenMeters=importepw.windSpeed,
    windDirection=importepw.windDirection,
    terrainType=number_slider_23,
    epwTerrain=number_slider_23,
    analysisPeriod=analysisperiod.analysisPeriod,
    originPt=point_8,
    windVectorScale=Slider(15, range=0..100),
    windProfileHeight=Slider(200, range=0..1000),
    distBetweenVec=Slider(8, range=0..10),
    windArrowStyle=Slider(2, range=0..10),
    legendPar=legendpar_2,
    bakeIt=Toggle(False))  # -> out, port, windSpeeds, windVectors, vectorAnchorPts, port_2, windVectorMesh, windProfileCurve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; plug-in component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

# ----
selectskymtx = Ladybug_selectSkyMtx(
    cumulativeSkyMtx=gencumulativeskymtx.cumulativeSkyMtx,
    analysisPeriod=analysisperiod.analysisPeriod,
    removeDiffuse=False,
    removeDirect=False)  # -> out, selectedSkyMtx; plug-in component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

# ---- group: SUNPATH
legendpar_3 = Ladybug_LegendParameters(font="Arial Narrow", fontSize=Slider(12, range=0..100), decimalPlaces=Slider(1, range=0..10))  # -> legendPar; plug-in component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
point_9 = Point(Point(0, 89.60729297, 0))
sunpath = Ladybug_SunPath(
    location=importepw.location,
    hour=12,
    day=21,
    month=12,
    timeStep=1,
    analysisPeriod=analysisperiod.analysisPeriod,
    centerPt=point_9,
    sunPathScale=Slider(1.2, range=0..5),
    sunScale=Slider(2, range=0..5),
    projection=Slider(0, range=0..2),
    annualHourlyData=flatten(importepw.dryBulbTemperature),
    legendPar=legendpar_3,
    dailyOrAnnualSunPath=True,
    bakeIt=Toggle(False))  # -> out, sunVectors, sunAltitudes, sunAzimuths, port, sunSpheresMesh, sunPathCrvs, compassCrvs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; plug-in component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
list_length = ListLength(List=sunpath.sunPositionsInfo)
construct_domain_5 = ConstructDomain(DomainStart="0", DomainEnd="1000")
random = Random(Range=construct_domain_5, Number=list_length, Seed=2)
panel_3 = Panel(random)
branchdatadailymonthlyhourly = Ladybug_BranchData(data=random, HOY=sunpath.sunPositionsHOY)  # -> dataEachDayOfYear, dataEachMonth, dataEachHourOfDay; plug-in component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
average = Average(Input=branchdatadailymonthlyhourly.dataEachMonth)
panel_4 = Panel(average)

# ---- group: SKY DOME
# SUNPATH
number_slider_24 = Slider(3, range=0..10)
# SKY DOME
number_slider_25 = Slider(5, range=0..10)
legendpar_4 = Ladybug_LegendParameters(font="Arial Narrow", fontSize=Slider(25, range=0..100), decimalPlaces=number_slider_24)  # -> legendPar; plug-in component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
skydome = Ladybug_SkyDome(
    selectedSkyMtx=selectskymtx.selectedSkyMtx,
    scale=number_slider_25,
    legendPar=legendpar_4,
    showTotalOnly=Toggle(True),
    runIt=Toggle(False))  # -> out, skyPatchesMesh, baseCrvs, altitudeCrvs, legend, legendBasePts, skyPatchesCenPts, skyPatchesAreas, skyPatchesAsBrep, values; plug-in component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

# ---- group: RADIATION ROSE
gradientlibrary_3 = Ladybug_GradientLibrary(gradIndex=Slider(6, range=1..23))  # -> customColors; plug-in component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
legendpar_5 = Ladybug_LegendParameters(
    customColors=flatten(gradientlibrary_3),
    legendScale=Slider(1, range=0..10),
    font="Arial Narrow",
    fontSize=Slider(12, range=0..100),
    decimalPlaces=Slider(3, range=0..10))  # -> legendPar; plug-in component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
point_10 = Point(Point(0, 89.60729297, 0))
radiationrose = Ladybug_RadiationRose(
    selectedSkyMtx=selectskymtx.selectedSkyMtx,
    centerPoint=point_10,
    scale=Slider(90, range=0..200),
    arrowHeadScale=1,
    legendPar=legendpar_5,
    showTotalOnly=Toggle(True),
    bakeIt=Toggle(False),
    runIt=Toggle(True))  # -> out, radiationArrowsMesh, radRoseBaseCrvs, legend, legendBasePts, radRoseEndPts, radRoseValues; plug-in component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

# ---- group: GEOMETRY
office_floors_podium = Brep([<brep referenced from the Rhino model> x2])
surrounding_context = Brep([<brep referenced from the Rhino model> x995])
facade = Brep(merge)

# ---- group: VIEW ROSE
# VIEW ROSE
# RADIATION ROSE
number_slider_26 = Slider(300, range=0..1000)
point_11 = Point(Point(15, 89.60729297, 0))
viewrose = Ladybug_viewRose(context=surrounding_context, plane=point_11, radius=number_slider_26)  # -> out, viewRose, blocked, visibleAngle; plug-in component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
surface = Surface(viewrose.viewRose)
surface_2 = Surface(viewrose.blocked)
panel_5 = Panel(viewrose.visibleAngle)

# ----
orientationstudypar = Ladybug_OrientationStudyParameters(divisionAngle=Slider(10, range=0..10), totalAngle=Slider(360, range=0..1000), runTheStudy=Toggle(True))  # -> orientationStudyPar; plug-in component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
custom_preview_6 = CustomPreview(Geometry=facade, Shader=ColourSwatch(SwatchColor=RGB(168, 71, 71)))
gradientlibrary_4 = Ladybug_GradientLibrary(gradIndex="1")  # -> customColors; plug-in component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
gradientlibrary_5 = Ladybug_GradientLibrary(gradIndex="3")  # -> customColors; plug-in component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
gradientlibrary_6 = Ladybug_GradientLibrary(gradIndex="6")  # -> customColors; plug-in component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
legendpar_6 = Ladybug_LegendParameters(
    customColors=flatten(gradientlibrary_5),
    legendScale=Slider(2, range=0..10),
    font="Arial Narrow",
    fontSize=Slider(5, range=0..100),
    decimalPlaces=Slider(3, range=0..10))  # -> legendPar; plug-in component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
# SUNLIGHT HRS ANALYSIS
number_slider_27 = Slider(5, range=0..10)
legendpar_7 = Ladybug_LegendParameters(
    customColors=flatten(gradientlibrary_4),
    legendScale=Slider(2, range=0..10),
    font="Arial Narrow",
    fontSize=Slider(5, range=0..100),
    decimalPlaces=Slider(2, range=0..10))  # -> legendPar; plug-in component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
legendpar_8 = Ladybug_LegendParameters(
    customColors=flatten(gradientlibrary_6),
    legendScale=Slider(1, range=0..10),
    font="Arial Narrow",
    fontSize=Slider(35, range=0..100),
    decimalPlaces=Slider(3, range=0..10))  # -> legendPar; plug-in component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
# RADIATION ANALYSIS
number_slider_28 = Slider(5, range=0..100)
# VIEW ANALYSIS
number_slider_29 = Slider(5, range=0..10)
radiationanalysis = Ladybug_RadiationAnalysis(
    geometry=flatten(office_floors_podium),
    context=flatten(surrounding_context),
    gridSize=number_slider_28,
    disFromBase=Slider(0.5, range=0..1),
    orientationStudyP=flatten(orientationstudypar),
    selectedSkyMtx=flatten(selectskymtx.selectedSkyMtx),
    legendPar=flatten(legendpar_8),
    parallel=Toggle(True),
    runIt=Toggle(False),
    bakeIt=Slider(2, range=0..10))  # -> out, contextMesh, analysisMesh, testPts, testVec, port, radiationResult, radiationMesh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; plug-in component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
initial_total_radiation = InitialTotalRadiation()  # -> march_2, june_2, september_2, december_2
viewanalysis = Ladybug_ViewAnalysis(
    geometry=flatten(office_floors_podium),
    context=flatten(facade),
    gridSize=number_slider_29,
    disFromBase=Slider(0.5, range=0..1),
    orientationStudyP=flatten(orientationstudypar),
    viewTypeOrPoints=flatten(Slider(1, range=0..5)),
    viewResolution=flatten(Slider(1, range=0..1)),
    geometryBlocksView=Toggle(False),
    legendPar=flatten(legendpar_6),
    parallel=Toggle(True),
    runIt=Toggle(False))  # -> out, contextMesh, analysisMesh, testPts, testVec, viewVec, port, viewStudyResult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; plug-in component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
sunlighthoursanalysis = Ladybug_SunlightHoursAnalysis(
    geometry=flatten(office_floors_podium),
    context=flatten(facade),
    gridSize=number_slider_27,
    disFromBase=Slider(0.5, range=0..1),
    orientationStudyP=flatten(orientationstudypar),
    sunVectors=flatten(sunpath.sunVectors),
    timeStep=Slider(1, range=0..1),
    legendPar=flatten(legendpar_7),
    parallel=Toggle(True),
    runIt=Toggle(False),
    bakeIt=Slider(2, range=0..10))  # -> out, contextMesh, analysisMesh, testPts, testVec, port, sunlightHoursResult, sunlightHoursMesh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; plug-in component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
flatten_tree = FlattenTree(Tree=radiationanalysis.radiationResult, Path="{0}")
flatten_tree_2 = FlattenTree(Tree=sunlighthoursanalysis.sunlightHoursResult, Path="{0}")
mesh = Mesh(sunlighthoursanalysis.sunlightHoursMesh)
flatten_tree_3 = FlattenTree(Tree=viewanalysis.viewStudyResult, Path="{0}")
larger_than = LargerThan(FirstNumber=flatten_tree_3, SecondNumber="45")  # -> LargerThan, OrEqualTo
cluster = Cluster_2(input=flatten_tree)  # -> total_radiation, max_radiation_2, min_radiation_2, reduction, of_reduction
mass_addition = MassAddition(Input=flatten_tree)  # -> Result, PartialResults
subtraction_3 = Subtraction(A=initial_total_radiation.september_2, B=mass_addition.Result)
division = Division(A=subtraction_3, B=initial_total_radiation.september_2)
sort_list_5 = SortList(Keys=flatten_tree)  # -> Keys, ValuesValuesA
list_length_2 = ListLength(List=larger_than.LargerThan)
number_9 = Number(larger_than.LargerThan)
multiplication = Multiplication(A=division, B="100")
sort_list_6 = SortList(Keys=flatten_tree_2)  # -> Keys, ValuesValuesA
average_2 = Average(Input=flatten_tree_2)
cluster_2 = Cluster(input=flatten_tree_3)  # -> average_view, max_view_2, min_view_2, quality_views
average_3 = Average(Input=flatten_tree_3)
sort_list_7 = SortList(Keys=flatten_tree_3)  # -> Keys, ValuesValuesA
panel_6 = Panel(number_9)
round_to_decimal_place_9 = RoundToDecimalPlace(NumberX=multiplication, DecimalPlace="2", RoundType=0)  # -> Rounded, Difference
list_item_12 = ListItem(List=reverse(sort_list_5.Keys), Index=0, Wrap=True)
list_item_13 = ListItem(List=sort_list_5.Keys, Index=0, Wrap=True)
mass_addition_2 = MassAddition(Input=panel_6)  # -> Result, PartialResults
list_item_14 = ListItem(List=reverse(sort_list_6.Keys), Index=0, Wrap=True)
list_item_15 = ListItem(List=sort_list_6.Keys, Index=0, Wrap=True)
list_item_16 = ListItem(List=reverse(sort_list_7.Keys), Index=0, Wrap=True)
list_item_17 = ListItem(List=sort_list_7.Keys, Index=0, Wrap=True)
number_10 = Number(list_item_12)
number_11 = Number(list_item_13)
number_12 = Number(list_item_14)
number_13 = Number(list_item_15)
division_2 = Division(A=mass_addition_2.Result, B=list_length_2)
total_radiation = Panel(mass_addition.Result)
max_radiation = Panel(number_10)
min_radiation = Panel(number_11)
of_reduction = Panel(round_to_decimal_place_9.Rounded)
reduction = Panel(subtraction_3)
number_14 = Number(list_item_16)
number_15 = Number(list_item_17)
avrg_sunlight = Panel(average_2)
max_sunlight = Panel(number_12)
min_sunlight = Panel(number_13)
min = Panel(number_15)
average_4 = Panel(average_3)
max = Panel(number_14)
multiplication_2 = Multiplication(A=division_2, B="100")
merge_2 = Merge(Data1=total_radiation, Data2=reduction, Data3=of_reduction)
of_quality_views = Panel(multiplication_2)
panel_7 = Panel(merge_2)
merge_3 = Merge(Data1=average_4, Data2=max, Data3=min, Data4=of_quality_views)
panel_8 = Panel(merge_3)
data_recorder = DataRecorder(DataLimit=-10, RecordData=True)
write_to_excel = WriteToExcel(
    Run=Toggle(False),
    ExcelWorksheet="1",
    WriteOptions="None",
    ColumnnsOrRows=Toggle(False),
    DataToWriteIntoColumns=data_recorder)
captureview = Ladybug_CaptureView(
    fileName="site",
    folder="C:\Users\URSULA\Desktop\THESIS\PROPOSALS\205_MAY\CHAPTER 4",
    viewNames="ISOMETRIC",
    imageWidth=Slider(3000, range=0..10000),
    imageHeight=Slider(1500, range=0..10000),
    transparBack=Toggle(True),
    capture=Toggle(False))  # -> Output; plug-in component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

# ==== cluster VerticalBehaviourWest

# ---- group: PANELS' VERTICAL BEHAVIOUR
md_slider = MDSlider(
    slider_value=Point(0.2038812405, 0.3011370403, 0.5),
    SliderMode=0,
    x_domain=Domain(0, 1),
    y_domain=Domain(0, 1),
    z_domain=Domain(0, 1))
md_slider_2 = MDSlider(
    slider_value=Point(0.2017643626, 0.1012513696, 0.5),
    SliderMode=0,
    x_domain=Domain(0, 1),
    y_domain=Domain(0, 1),
    z_domain=Domain(0, 1))
md_slider_3 = MDSlider(
    slider_value=Point(0.2002639771, 0, 0.5),
    SliderMode=0,
    x_domain=Domain(0, 1),
    y_domain=Domain(0, 1),
    z_domain=Domain(0, 1))
md_slider_4 = MDSlider(
    slider_value=Point(0.2006895484, 0.3992413777, 0.5),
    SliderMode=0,
    x_domain=Domain(0, 1),
    y_domain=Domain(0, 1),
    z_domain=Domain(0, 1))
md_slider_5 = MDSlider(
    slider_value=Point(0.1987453554, 0.1996995879, 0.5),
    SliderMode=0,
    x_domain=Domain(0, 1),
    y_domain=Domain(0, 1),
    z_domain=Domain(0, 1))
md_slider_6 = MDSlider(
    slider_value=Point(0.5023952577, 0.398441966, 0.5),
    SliderMode=0,
    x_domain=Domain(0, 1),
    y_domain=Domain(0, 1),
    z_domain=Domain(0, 1))
md_slider_7 = MDSlider(
    slider_value=Point(0.4984532798, 0.1996995879, 0.5),
    SliderMode=0,
    x_domain=Domain(0, 1),
    y_domain=Domain(0, 1),
    z_domain=Domain(0, 1))
md_slider_8 = MDSlider(
    slider_value=Point(0.5049661776, 0.2986986114, 0.5),
    SliderMode=0,
    x_domain=Domain(0, 1),
    y_domain=Domain(0, 1),
    z_domain=Domain(0, 1))
md_slider_9 = MDSlider(
    slider_value=Point(0.4964763362, 0.1036287633, 0.5),
    SliderMode=0,
    x_domain=Domain(0, 1),
    y_domain=Domain(0, 1),
    z_domain=Domain(0, 1))
md_slider_10 = MDSlider(
    slider_value=Point(0.5005971397, 0, 0.5),
    SliderMode=0,
    x_domain=Domain(0, 1),
    y_domain=Domain(0, 1),
    z_domain=Domain(0, 1))
md_slider_11 = MDSlider(
    slider_value=Point(0.7978322099, 0.4023132324, 0.5),
    SliderMode=0,
    x_domain=Domain(0, 1),
    y_domain=Domain(0, 1),
    z_domain=Domain(0, 1))
md_slider_12 = MDSlider(
    slider_value=Point(0.7955575338, 0.3026979028, 0.5),
    SliderMode=0,
    x_domain=Domain(0, 1),
    y_domain=Domain(0, 1),
    z_domain=Domain(0, 1))
md_slider_13 = MDSlider(
    slider_value=Point(0.8004924495, 0.1030586057, 0.5),
    SliderMode=0,
    x_domain=Domain(0, 1),
    y_domain=Domain(0, 1),
    z_domain=Domain(0, 1))
md_slider_14 = MDSlider(
    slider_value=Point(0.8030291301, 0, 0.5),
    SliderMode=0,
    x_domain=Domain(0, 1),
    y_domain=Domain(0, 1),
    z_domain=Domain(0, 1))
md_slider_15 = MDSlider(
    slider_value=Point(0.7988072837, 0.2014301579, 0.5),
    SliderMode=0,
    x_domain=Domain(0, 1),
    y_domain=Domain(0, 1),
    z_domain=Domain(0, 1))

# ----
merge = Merge(Data1=md_slider_2, Data2=md_slider_9, Data3=md_slider_13, Data4=md_slider_3, Data5=md_slider_10, Data6=md_slider_14)
merge_2 = Merge(
    Data1=md_slider_2,
    Data2=md_slider_9,
    Data3=md_slider_13,
    Data4=md_slider_3,
    Data5=md_slider_10,
    Data6=md_slider_14,
    Data7=md_slider_5,
    Data8=md_slider_7,
    Data9=md_slider_15,
    Data10=md_slider,
    Data11=md_slider_8,
    Data12=md_slider_12,
    Data13=md_slider_4,
    Data14=md_slider_6,
    Data15=md_slider_11)
merge_3 = Merge(Data1=md_slider_2, Data2=md_slider_9, Data3=md_slider_13, Data4=md_slider_3, Data5=md_slider_10, Data6=md_slider_14)
merge_4 = Merge(Data1=md_slider_2, Data2=md_slider_9, Data3=md_slider_13, Data4=md_slider_3, Data5=md_slider_10, Data6=md_slider_14)
march = ClusterOutput(merge)
june = ClusterOutput(merge_2)

# ---- group: Cluster Output
september = ClusterOutput(merge_3)

december = ClusterOutput(merge_4)

# ==== cluster VerticalBehaviourNorth

# ---- group: PANELS' VERTICAL BEHAVIOUR
md_slider = MDSlider(
    slider_value=Point(0.2017643626, 0.1012513696, 0.5),
    SliderMode=0,
    x_domain=Domain(0, 1),
    y_domain=Domain(0, 1),
    z_domain=Domain(0, 1))
md_slider_2 = MDSlider(
    slider_value=Point(0.2006895484, 0.3992413777, 0.5),
    SliderMode=0,
    x_domain=Domain(0, 1),
    y_domain=Domain(0, 1),
    z_domain=Domain(0, 1))
md_slider_3 = MDSlider(
    slider_value=Point(0.2038812405, 0.3011370403, 0.5),
    SliderMode=0,
    x_domain=Domain(0, 1),
    y_domain=Domain(0, 1),
    z_domain=Domain(0, 1))
md_slider_4 = MDSlider(
    slider_value=Point(0.1987453554, 0.1996995879, 0.5),
    SliderMode=0,
    x_domain=Domain(0, 1),
    y_domain=Domain(0, 1),
    z_domain=Domain(0, 1))
md_slider_5 = MDSlider(
    slider_value=Point(0.2002639771, 0, 0.5),
    SliderMode=0,
    x_domain=Domain(0, 1),
    y_domain=Domain(0, 1),
    z_domain=Domain(0, 1))
md_slider_6 = MDSlider(
    slider_value=Point(0.5023952577, 0.398441966, 0.5),
    SliderMode=0,
    x_domain=Domain(0, 1),
    y_domain=Domain(0, 1),
    z_domain=Domain(0, 1))
md_slider_7 = MDSlider(
    slider_value=Point(0.5049661776, 0.2986986114, 0.5),
    SliderMode=0,
    x_domain=Domain(0, 1),
    y_domain=Domain(0, 1),
    z_domain=Domain(0, 1))
md_slider_8 = MDSlider(
    slider_value=Point(0.4984532798, 0.1996995879, 0.5),
    SliderMode=0,
    x_domain=Domain(0, 1),
    y_domain=Domain(0, 1),
    z_domain=Domain(0, 1))
md_slider_9 = MDSlider(
    slider_value=Point(0.4964763362, 0.1036287633, 0.5),
    SliderMode=0,
    x_domain=Domain(0, 1),
    y_domain=Domain(0, 1),
    z_domain=Domain(0, 1))
md_slider_10 = MDSlider(
    slider_value=Point(0.5005971397, 0, 0.5),
    SliderMode=0,
    x_domain=Domain(0, 1),
    y_domain=Domain(0, 1),
    z_domain=Domain(0, 1))
md_slider_11 = MDSlider(
    slider_value=Point(0.7978322099, 0.4023132324, 0.5),
    SliderMode=0,
    x_domain=Domain(0, 1),
    y_domain=Domain(0, 1),
    z_domain=Domain(0, 1))
md_slider_12 = MDSlider(
    slider_value=Point(0.7955575338, 0.3026979028, 0.5),
    SliderMode=0,
    x_domain=Domain(0, 1),
    y_domain=Domain(0, 1),
    z_domain=Domain(0, 1))
md_slider_13 = MDSlider(
    slider_value=Point(0.7988072837, 0.2014301579, 0.5),
    SliderMode=0,
    x_domain=Domain(0, 1),
    y_domain=Domain(0, 1),
    z_domain=Domain(0, 1))
md_slider_14 = MDSlider(
    slider_value=Point(0.8004924495, 0.1030586057, 0.5),
    SliderMode=0,
    x_domain=Domain(0, 1),
    y_domain=Domain(0, 1),
    z_domain=Domain(0, 1))
md_slider_15 = MDSlider(
    slider_value=Point(0.8030291301, 0, 0.5),
    SliderMode=0,
    x_domain=Domain(0, 1),
    y_domain=Domain(0, 1),
    z_domain=Domain(0, 1))

# ----
merge = Merge(
    Data1=md_slider_4,
    Data2=md_slider_8,
    Data3=md_slider_13,
    Data4=md_slider,
    Data5=md_slider_9,
    Data6=md_slider_14,
    Data7=md_slider_5,
    Data8=md_slider_10,
    Data9=md_slider_15,
    Data10=md_slider_3,
    Data11=md_slider_7,
    Data12=md_slider_12,
    Data13=md_slider_2,
    Data14=md_slider_6,
    Data15=md_slider_11)
merge_2 = Merge(
    Data1=md_slider_4,
    Data2=md_slider_8,
    Data3=md_slider_13,
    Data4=md_slider,
    Data5=md_slider_9,
    Data6=md_slider_14,
    Data7=md_slider_5,
    Data8=md_slider_10,
    Data9=md_slider_15)
merge_3 = Merge(
    Data1=md_slider_4,
    Data2=md_slider_8,
    Data3=md_slider_13,
    Data4=md_slider,
    Data5=md_slider_9,
    Data6=md_slider_14,
    Data7=md_slider_5,
    Data8=md_slider_10,
    Data9=md_slider_15)
merge_4 = Merge(
    Data1=md_slider_4,
    Data2=md_slider_8,
    Data3=md_slider_13,
    Data4=md_slider,
    Data5=md_slider_9,
    Data6=md_slider_14,
    Data7=md_slider_5,
    Data8=md_slider_10,
    Data9=md_slider_15,
    Data10=md_slider_3,
    Data11=md_slider_7,
    Data12=md_slider_12,
    Data13=md_slider_2,
    Data14=md_slider_6,
    Data15=md_slider_11)

# ---- group: Cluster Output
march = ClusterOutput(merge_2)

june = ClusterOutput(merge_4)

september = ClusterOutput(merge_3)

december = ClusterOutput(merge)

# ==== cluster VerticalBehaviourEast

# ---- group: PANELS' VERTICAL BEHAVIOUR
md_slider = MDSlider(
    slider_value=Point(0.2006895484, 0.3992413777, 0.5),
    SliderMode=0,
    x_domain=Domain(0, 1),
    y_domain=Domain(0, 1),
    z_domain=Domain(0, 1))
md_slider_2 = MDSlider(
    slider_value=Point(0.2038812405, 0.3011370403, 0.5),
    SliderMode=0,
    x_domain=Domain(0, 1),
    y_domain=Domain(0, 1),
    z_domain=Domain(0, 1))
md_slider_3 = MDSlider(
    slider_value=Point(0.2017643626, 0.1012513696, 0.5),
    SliderMode=0,
    x_domain=Domain(0, 1),
    y_domain=Domain(0, 1),
    z_domain=Domain(0, 1))
md_slider_4 = MDSlider(
    slider_value=Point(0.2002639771, 0, 0.5),
    SliderMode=0,
    x_domain=Domain(0, 1),
    y_domain=Domain(0, 1),
    z_domain=Domain(0, 1))
md_slider_5 = MDSlider(
    slider_value=Point(0.1987453554, 0.1996995879, 0.5),
    SliderMode=0,
    x_domain=Domain(0, 1),
    y_domain=Domain(0, 1),
    z_domain=Domain(0, 1))
md_slider_6 = MDSlider(
    slider_value=Point(0.5023952577, 0.398441966, 0.5),
    SliderMode=0,
    x_domain=Domain(0, 1),
    y_domain=Domain(0, 1),
    z_domain=Domain(0, 1))
md_slider_7 = MDSlider(
    slider_value=Point(0.4984532798, 0.1996995879, 0.5),
    SliderMode=0,
    x_domain=Domain(0, 1),
    y_domain=Domain(0, 1),
    z_domain=Domain(0, 1))
md_slider_8 = MDSlider(
    slider_value=Point(0.4964763362, 0.1036287633, 0.5),
    SliderMode=0,
    x_domain=Domain(0, 1),
    y_domain=Domain(0, 1),
    z_domain=Domain(0, 1))
md_slider_9 = MDSlider(
    slider_value=Point(0.5049661776, 0.2986986114, 0.5),
    SliderMode=0,
    x_domain=Domain(0, 1),
    y_domain=Domain(0, 1),
    z_domain=Domain(0, 1))
md_slider_10 = MDSlider(
    slider_value=Point(0.5005971397, 0, 0.5),
    SliderMode=0,
    x_domain=Domain(0, 1),
    y_domain=Domain(0, 1),
    z_domain=Domain(0, 1))
md_slider_11 = MDSlider(
    slider_value=Point(0.7978322099, 0.4023132324, 0.5),
    SliderMode=0,
    x_domain=Domain(0, 1),
    y_domain=Domain(0, 1),
    z_domain=Domain(0, 1))
md_slider_12 = MDSlider(
    slider_value=Point(0.7955575338, 0.3026979028, 0.5),
    SliderMode=0,
    x_domain=Domain(0, 1),
    y_domain=Domain(0, 1),
    z_domain=Domain(0, 1))
md_slider_13 = MDSlider(
    slider_value=Point(0.8004924495, 0.1030586057, 0.5),
    SliderMode=0,
    x_domain=Domain(0, 1),
    y_domain=Domain(0, 1),
    z_domain=Domain(0, 1))
md_slider_14 = MDSlider(
    slider_value=Point(0.8030291301, 0, 0.5),
    SliderMode=0,
    x_domain=Domain(0, 1),
    y_domain=Domain(0, 1),
    z_domain=Domain(0, 1))
md_slider_15 = MDSlider(
    slider_value=Point(0.7988072837, 0.2014301579, 0.5),
    SliderMode=0,
    x_domain=Domain(0, 1),
    y_domain=Domain(0, 1),
    z_domain=Domain(0, 1))

# ----
merge = Merge(Data1=md_slider_3, Data2=md_slider_8, Data3=md_slider_13, Data4=md_slider_4, Data5=md_slider_10, Data6=md_slider_14)
merge_2 = Merge(
    Data1=md_slider_4,
    Data2=md_slider_10,
    Data3=md_slider_14,
    Data4=md_slider_3,
    Data5=md_slider_8,
    Data6=md_slider_13,
    Data7=md_slider_5,
    Data8=md_slider_7,
    Data9=md_slider_15)
merge_3 = Merge(Data1=md_slider_3, Data2=md_slider_8, Data3=md_slider_13, Data4=md_slider_4, Data5=md_slider_10, Data6=md_slider_14)
merge_4 = Merge(
    Data1=md_slider_4,
    Data2=md_slider_10,
    Data3=md_slider_14,
    Data4=md_slider_3,
    Data5=md_slider_8,
    Data6=md_slider_13,
    Data7=md_slider_5,
    Data8=md_slider_7,
    Data9=md_slider_15)

# ---- group: Cluster Output
march = ClusterOutput(merge)

june = ClusterOutput(merge_2)

september = ClusterOutput(merge_3)

december = ClusterOutput(merge_4)

# ==== cluster VerticalBehaviourSouth

# ---- group: PANELS' VERTICAL BEHAVIOUR
md_slider = MDSlider(
    slider_value=Point(0.2006895484, 0.3992413777, 0.5),
    SliderMode=0,
    x_domain=Domain(0, 1),
    y_domain=Domain(0, 1),
    z_domain=Domain(0, 1))
md_slider_2 = MDSlider(
    slider_value=Point(0.2038812405, 0.3011370403, 0.5),
    SliderMode=0,
    x_domain=Domain(0, 1),
    y_domain=Domain(0, 1),
    z_domain=Domain(0, 1))
md_slider_3 = MDSlider(
    slider_value=Point(0.1987453554, 0.1996995879, 0.5),
    SliderMode=0,
    x_domain=Domain(0, 1),
    y_domain=Domain(0, 1),
    z_domain=Domain(0, 1))
md_slider_4 = MDSlider(
    slider_value=Point(0.2017643626, 0.1012513696, 0.5),
    SliderMode=0,
    x_domain=Domain(0, 1),
    y_domain=Domain(0, 1),
    z_domain=Domain(0, 1))
md_slider_5 = MDSlider(
    slider_value=Point(0.2002639771, 0, 0.5),
    SliderMode=0,
    x_domain=Domain(0, 1),
    y_domain=Domain(0, 1),
    z_domain=Domain(0, 1))
md_slider_6 = MDSlider(
    slider_value=Point(0.5023952577, 0.398441966, 0.5),
    SliderMode=0,
    x_domain=Domain(0, 1),
    y_domain=Domain(0, 1),
    z_domain=Domain(0, 1))
md_slider_7 = MDSlider(
    slider_value=Point(0.4984532798, 0.1996995879, 0.5),
    SliderMode=0,
    x_domain=Domain(0, 1),
    y_domain=Domain(0, 1),
    z_domain=Domain(0, 1))
md_slider_8 = MDSlider(
    slider_value=Point(0.4964763362, 0.1036287633, 0.5),
    SliderMode=0,
    x_domain=Domain(0, 1),
    y_domain=Domain(0, 1),
    z_domain=Domain(0, 1))
md_slider_9 = MDSlider(
    slider_value=Point(0.5005971397, 0, 0.5),
    SliderMode=0,
    x_domain=Domain(0, 1),
    y_domain=Domain(0, 1),
    z_domain=Domain(0, 1))
md_slider_10 = MDSlider(
    slider_value=Point(0.5049661776, 0.2986986114, 0.5),
    SliderMode=0,
    x_domain=Domain(0, 1),
    y_domain=Domain(0, 1),
    z_domain=Domain(0, 1))
md_slider_11 = MDSlider(
    slider_value=Point(0.7978322099, 0.4023132324, 0.5),
    SliderMode=0,
    x_domain=Domain(0, 1),
    y_domain=Domain(0, 1),
    z_domain=Domain(0, 1))
md_slider_12 = MDSlider(
    slider_value=Point(0.7955575338, 0.3026979028, 0.5),
    SliderMode=0,
    x_domain=Domain(0, 1),
    y_domain=Domain(0, 1),
    z_domain=Domain(0, 1))
md_slider_13 = MDSlider(
    slider_value=Point(0.7988072837, 0.2014301579, 0.5),
    SliderMode=0,
    x_domain=Domain(0, 1),
    y_domain=Domain(0, 1),
    z_domain=Domain(0, 1))
md_slider_14 = MDSlider(
    slider_value=Point(0.8004924495, 0.1030586057, 0.5),
    SliderMode=0,
    x_domain=Domain(0, 1),
    y_domain=Domain(0, 1),
    z_domain=Domain(0, 1))
md_slider_15 = MDSlider(
    slider_value=Point(0.8030291301, 0, 0.5),
    SliderMode=0,
    x_domain=Domain(0, 1),
    y_domain=Domain(0, 1),
    z_domain=Domain(0, 1))

# ----
merge = Merge(
    Data1=md_slider_4,
    Data2=md_slider_8,
    Data3=md_slider_14,
    Data4=md_slider_5,
    Data5=md_slider_9,
    Data6=md_slider_15,
    Data7=md_slider_3,
    Data8=md_slider_7,
    Data9=md_slider_13,
    Data10=md_slider_2,
    Data11=md_slider_10,
    Data12=md_slider_12,
    Data13=md_slider,
    Data14=md_slider_6,
    Data15=md_slider_11)
merge_2 = Merge(
    Data1=md_slider_4,
    Data2=md_slider_8,
    Data3=md_slider_14,
    Data4=md_slider_5,
    Data5=md_slider_9,
    Data6=md_slider_15,
    Data7=md_slider_3,
    Data8=md_slider_7,
    Data9=md_slider_13,
    Data10=md_slider_2,
    Data11=md_slider_10,
    Data12=md_slider_12,
    Data13=md_slider,
    Data14=md_slider_6,
    Data15=md_slider_11)
merge_3 = Merge(
    Data1=md_slider_4,
    Data2=md_slider_8,
    Data3=md_slider_14,
    Data4=md_slider_5,
    Data5=md_slider_9,
    Data6=md_slider_15,
    Data7=md_slider_3,
    Data8=md_slider_7,
    Data9=md_slider_13,
    Data10=md_slider_2,
    Data11=md_slider_10,
    Data12=md_slider_12,
    Data13=md_slider,
    Data14=md_slider_6,
    Data15=md_slider_11)
merge_4 = Merge(Data1=md_slider_4, Data2=md_slider_8, Data3=md_slider_14, Data4=md_slider_5, Data5=md_slider_9, Data6=md_slider_15)

# ---- group: Cluster Output
september = ClusterOutput(merge)

march = ClusterOutput(merge_2)

june = ClusterOutput(merge_3)

december = ClusterOutput(merge_4)

# ==== cluster Cluster

# ---- group: Cluster Input
input = ClusterInput()

# ----
larger_than = LargerThan(FirstNumber=input, SecondNumber="45")  # -> LargerThan, OrEqualTo
list_length = ListLength(List=larger_than.LargerThan)
number = Number(larger_than.LargerThan)
average = Average(Input=input)
sort_list = SortList(Keys=input)  # -> Keys, ValuesValuesA
panel = Panel(number)
mass_addition = MassAddition(Input=panel)  # -> Result, PartialResults
list_item = ListItem(List=reverse(sort_list.Keys), Index=0, Wrap=True)
list_item_2 = ListItem(List=sort_list.Keys, Index=0, Wrap=True)
division = Division(A=mass_addition.Result, B=list_length)
max_view = Number(list_item)
min_view = Number(list_item_2)
multiplication = Multiplication(A=division, B="100")

# ---- group: Cluster Output
average_view = ClusterOutput(average)

max_view_2 = ClusterOutput(max_view)

min_view_2 = ClusterOutput(min_view)

quality_views = ClusterOutput(multiplication)

# ==== cluster Cluster_2

# ---- group: Cluster Input
input = ClusterInput()

A = ClusterInput()

# ----
mass_addition = MassAddition(Input=input)  # -> TotalRadiation, PartialResults
subtraction = Subtraction(A=A, B=mass_addition.TotalRadiation)
division = Division(A=subtraction, B=A)
sort_list = SortList(Keys=input)  # -> Keys, ValuesValuesA
multiplication = Multiplication(A=division, B="100")
round_to_decimal_place = RoundToDecimalPlace(NumberX=multiplication, DecimalPlace=Slider(2, range=0..10), RoundType=0)  # -> OfReduction, Difference
list_item = ListItem(List=reverse(sort_list.Keys), Index=0, Wrap=True)
list_item_2 = ListItem(List=sort_list.Keys, Index=0, Wrap=True)
max_radiation = Number(list_item)
min_radiation = Number(list_item_2)

# ---- group: Cluster Output
total_radiation = ClusterOutput(mass_addition.TotalRadiation)

max_radiation_2 = ClusterOutput(max_radiation)

min_radiation_2 = ClusterOutput(min_radiation)

reduction = ClusterOutput(subtraction)

of_reduction = ClusterOutput(round_to_decimal_place.OfReduction)

# ==== cluster InitialTotalRadiation
march = Data("5580.61")
june = Data("5954.68")
september = Data("5865.75")
december = Data("4856.88")

# ---- group: Cluster Output
march_2 = ClusterOutput(march)

june_2 = ClusterOutput(june)

september_2 = ClusterOutput(september)

december_2 = ClusterOutput(december)
